% Simulink data dictionary ssl_robot.sldd

sat_v = Simulink.Parameter(3, DataType="double")
sat_w = Simulink.Parameter(10, DataType="double")
Ts = Simulink.Parameter(0.01666667, DataType="double")
K_vx = Simulink.Parameter(1, StorageClass="SimulinkGlobal", DataType="double", Min=0.5, Max=2)
tau_vx = Simulink.Parameter(0.01, StorageClass="SimulinkGlobal", DataType="double", Min=0.01, Max=0.5)
Td_vx = Simulink.Parameter(0, StorageClass="SimulinkGlobal", DataType="double", Min=0, Max=0.2)
K_vy = Simulink.Parameter(1, StorageClass="SimulinkGlobal", DataType="double", Min=0.5, Max=2)
tau_vy = Simulink.Parameter(0.01, StorageClass="SimulinkGlobal", DataType="double", Min=0.01, Max=0.5)
Td_vy = Simulink.Parameter(0, StorageClass="SimulinkGlobal", DataType="double", Min=0, Max=0.2)
K_w = Simulink.Parameter(1, StorageClass="SimulinkGlobal", DataType="double", Min=0.5, Max=2)
tau_w = Simulink.Parameter(0.01, StorageClass="SimulinkGlobal", DataType="double", Min=0.01, Max=0.5)
Td_w = Simulink.Parameter(0, StorageClass="SimulinkGlobal", DataType="double", Min=0, Max=0.2)